# Grasshopper definition pattern_sample_withBorder.gh (Grasshopper 1.0.7)
# Copyright: Arup
# plug-ins: LunchBox

crv = Curve(<curve referenced from the Rhino model>)
crv_2 = Curve(<curve referenced from the Rhino model>)
quadstag = StaggeredQuadPanels(Surface=crv_2, UDivisions=Slider(36, range=0..100), VDivisions=Slider(81, range=0..100))
boundary = BoundarySurfaces(Edges=crv_2)  # -> reparameterize(Surfaces)
pcen = PolygonCenter(Polyline=quadstag)  # -> CenterV, CenterE, CenterA
srf_cp = SurfaceClosestPoint(Point=pcen.CenterV, Surface=boundary)  # -> Point, UVPoint, Distance
image = ImageSampler(
    srf_cp.UVPoint,
    FilePath="C:\Users\yishizu\Desktop\Q&A kuroda\òùé╠ù¼éΩé╠ë≡É═.jpg",
    Filter="Value",
    Interpolate=True,
    Umax=1,
    Umin=0,
    Vmax=1,
    Vmin=0,
    Wrap=1)

lng = ListLength(List=image)
dom = ConstructDomain(DomainStart=Slider(0, range=0..100), DomainEnd=Slider(0.38, range=0..1))
random = Random(Range=dom, Number=lng, Seed=Slider(431, range=0..1000))
addition = Addition(A=image, B=random)

number_slider = Slider(7, range=0..10)
range = Range(Domain=Domain(0, 1), Steps=number_slider)
gradient = Gradient(LowerLimit=0, UpperLimit=1, Parameter=expr("1-x", range), stops=[0.136: RGB(224, 224, 224), 0.85: RGB(105, 120, 105)])
merge = Merge(
    Data1=ColourSwatch(SwatchColor=RGB(255, 255, 255)),
    Data2=ColourSwatch(SwatchColor=RGB(217, 217, 217)),
    Data3=ColourSwatch(SwatchColor=RGB(201, 201, 201)),
    Data4=ColourSwatch(SwatchColor=RGB(171, 171, 171)),
    Data5=ColourSwatch(SwatchColor=RGB(128, 128, 128)),
    Data6=ColourSwatch(SwatchColor=RGB(89, 97, 102)),
    Data7=ColourSwatch(SwatchColor=RGB(51, 61, 82)))  # -> reverse(Result)
remap = RemapNumbers(Value=addition, Source=Domain(0, 1), Target=number_slider)  # -> Mapped, Clipped
int = Integer(remap.Mapped)
item = ListItem(List=merge, Index=int, Wrap=True)
incurve = PointInCurve(Point=pcen.CenterV, Curve=crv)  # -> Relationship, Point
equals = Equality(FirstNumber=incurve.Relationship, SecondNumber=2)  # -> Equality, Inequality
dispatch = Dispatch(List=quadstag, DispatchPattern=equals.Equality)  # -> ListA, ListB
dispatch_2 = Dispatch(List=item, DispatchPattern=equals.Equality)  # -> ListA, ListB
preview = CustomPreview(Geometry=dispatch.ListA, Material=dispatch_2.ListA)
