# Grasshopper definition Class5_Form_finding_with_Ladybug.gh (Grasshopper 1.0.7)
# Copyright: Arup
# plug-ins: MeshEdit Components, Bifocals

# ----
# Inputパラメータ
# パラメトリックモデル用
number_slider = Slider(99.529, range=0..100)
カーブ同士の角度 = Slider(0.09, range=0..0.1)
number_slider_2 = Slider(6257, range=1000..15000)

# ----
# 建物用カーブ
crv = Curve([<curve referenced from the Rhino model> x2])

# ----
# epwFile
path = FilePath("C:\Users\yishizu\OneDrive - Cadmakers\Projects\005_KajimaGHWorkshop\Class5\LadyBug\Class5\JPN_SZ_Hamamatsu.476540_JGMY.epw")

# ----
# 解析時間
number_slider_3 = Slider(12, range=0..100)
number_slider_4 = Slider(22, range=0..100)

# ----
# 周辺建物
geo = Geometry([<brep referenced from the Rhino model> x49, <curve referenced from the Rhino model> x51, <brep referenced from the Rhino model> x2])
smesh = SimpleMesh(Brep=geo)

# ----
# Input & Parameter
# Form Finding with Ladybug: An example to do solar radiation optimization using Ladybug & Galapagos.
# 
# Using plugin: Ladybug
data = Data(1)

# ----
# Method
data_2 = Data(2)

# ----
# Output
data_3 = Data(2)

# ----
# Visualization
# Step1.パラメトリックモデルをつくる
data_4 = Data(2)

# ----
# Step1-1.ベースとなるフロアのジオメトリをつくる
pcen = PolygonCenter(Polyline=crv)  # -> CenterV, CenterE, CenterA
number_slider_5 = Slider(5500, range=0..10000)
rad = Radians(Degrees=number_slider)
rotate = Rotate(Geometry=crv, Angle=rad, Plane=pcen.CenterV)  # -> Geometry, Transform
runion = RegionUnion(Curves=rotate.Geometry)
Z = UnitZ(Factor=number_slider_5)
fillet = Fillet(Curve=runion, Radius=number_slider_2)
move = Move(Geometry=fillet, Motion=Z)  # -> Geometry, Transform

# ----
# Unused
data_5 = Data(2)

# ----
# Unused
data_6 = Data(2)

number_slider_6 = Slider(4200, range=0..10000)
number_slider_7 = Slider(10, range=0..10)
series = Series(Start=number_slider_6, Step=number_slider_6, Count=number_slider_7)
Z_2 = UnitZ(Factor=series)

# ----
# Step1-2.ファサードのベースとなるサーフェスをつくる
number_slider_8 = Slider(0, range=0..100)
move_2 = Move(Geometry=move.Geometry, Motion=Z_2)  # -> Geometry, Transform
area = Area(Geometry=move_2.Geometry)  # -> Area, Centroid
series_2 = Series(Start=number_slider_8, Step=カーブ同士の角度, Count=number_slider_7)
repeat = RepeatData(Data=number_slider_6, Length=number_slider_7)
rotate_2 = Rotate(Geometry=move_2.Geometry, Angle=series_2, Plane=area.Centroid)  # -> Geometry, Transform
merge = Merge(Data1=flatten(number_slider_5), Data2=flatten(repeat))
merge_2 = Merge(Data1=flatten(move.Geometry), Data2=flatten(rotate_2.Geometry))
Z_3 = UnitZ(Factor=expr("x*-1", merge))
extr = Extrude(Base=merge_2, Direction=Z_3)

explode = Explode(Curve=merge_2, Recursive=True)  # -> reparameterize(Segments), Vertices
len = Length(Curve=explode.Segments)
division = Division(A=len, B=Slider(1131, range=0..2000))
divide = DivideCurve(Curve=explode.Segments, Count=division, Kinks=False)  # -> Points, Tangents, Parameters
shift = ShiftList(List=divide.Points, Shift=-1, Wrap=False)
shift_2 = ShiftList(List=divide.Points, Shift=1, Wrap=False)
ln = Line(StartPoint=shift_2, EndPoint=shift)  # -> simplify(Line)
Z_4 = UnitZ(Factor=expr("x*-1", merge))
pshift = ShiftPaths(Data=simplify(ln), Offset=-1)
extr_2 = Extrude(Base=pshift, Direction=simplify(graft(Z_4)))

# ----
# Step1-3.スラブをつくる
merge_3 = Merge(Data1=flatten(fillet), Data2=flatten(merge_2))
boundary = BoundarySurfaces(Edges=graft(merge_3))
Z_5 = UnitZ(Factor=Slider(1000, range=0..1000))  # -> expr("-x", UnitVector)
extr_3 = Extrude(Base=graft(boundary), Direction=Z_5)

# ----
# Step1-4.解析用のメッシュをつくる
debrep = DeconstructBrep(Brep=extr)  # -> Faces, Edges, Vertices
edges = BrepEdges(Brep=debrep.Faces)  # -> Naked, Interior, NonManifold
item = ListItem(List=edges.Naked, Index=1, Wrap=True)
len_2 = Length(Curve=item)
division_2 = Division(A=len_2, B=Slider(1131, range=0..2000))
pshift_2 = ShiftPaths(Data=division_2, Offset=-1)
mesh_uv = MeshSurface(Surface=debrep.Faces, UCount=Slider(1, range=0..1), VCount=pshift_2, Overhang=True, Equalize=False)
faceb = FaceBoundaries(Mesh=mesh_uv)

area_2 = Area(Geometry=boundary)  # -> Area, Centroid
scale = Scale(Geometry=extr_3, Center=area_2.Centroid, Factor=Slider(0.992, range=0..1))  # -> Geometry, Transform

preview = CustomPreview(Geometry=[scale.Geometry, boundary], Material=ColourSwatch(SwatchColor=RGB(117, 117, 117)))

custom_mesh_settings = SettingsCustom(
    StitchSeams=True,
    SimplePlanes=True,
    Refine=True,
    MinCount=16,
    MaxCount=400,
    AspectRatio=20,
    MaxDistance=0,
    MaxAngle=20,
    MinEdge=0,
    MaxEdge=0)
mesh = MeshBrep(Brep=extr_2, Settings=custom_mesh_settings)
faceb_2 = FaceBoundaries(Mesh=mesh)

preview_2 = CustomPreview(Geometry=extr_2, Material=ColourSwatch(SwatchColor=RGBA(77, 163, 191, 118)))

toggle = BooleanToggle(True)  # disabled
downloadepw = Ladybug_downloadEPWWeatherFile(download=toggle)  # -> readMe; disabled; plug-in component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

# ----
# Step2.LadyBugで日照シミュレーション
ladybug = Ladybug_Ladybug()  # -> Vviiiiiiiiiizzz; disabled; plug-in component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

# ---- group: Step4-2
panel = Panel("https://www.energyplus.net/weather-download/asia_wmo_region_2/JPN//JPN_Tokyo.Hyakuri.477150_IWEC/all")  # disabled

# ----
# Step2-1.ファイルを指定して、epwを読み込む
toggle_2 = BooleanToggle(True)  # disabled
epw_stat = Ladybug_OpenEPWAndSTATWeatherFiles(weatherFileURL=panel)  # -> epwFile, statFile; disabled; plug-in component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
gencumulativeskymtx = Ladybug_GenCumulativeSkyMtx(epwFile=path, skyDensity=0, useOldRes=True, runIt=toggle_2)  # -> readMe, cumulativeSkyMtx; disabled; plug-in component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
analysisperiod = Ladybug_AnalysisPeriod(fromMonth=number_slider_3, fromDay=number_slider_4, toMonth=number_slider_3, toDay=number_slider_4)  # -> readMe, analysisPeriod; disabled; plug-in component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
importepw = Ladybug_ImportEpw(epwFile=epw_stat.epwFile)  # -> readMe, latitude, location, dryBulbTemperature, dewPointTemperature, relativeHumidity, windSpeed, windDirection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; disabled; plug-in component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
selectskymtx = Ladybug_selectSkyMtx(
    cumulativeSkyMtx=gencumulativeskymtx.cumulativeSkyMtx,
    analysisPeriod=analysisperiod.analysisPeriod,
    removeDiffuse=False,
    removeDirect=False)  # -> readMe, selectedSkyMtx; disabled; plug-in component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

number_slider_9 = Slider(1, range=0..1)  # disabled
number_slider_10 = Slider(1000, range=0..1000)  # disabled

# ----
# Step2-2.ジオメトリやパラメータを設定する
# Step2-3.解析をかける
toggle_3 = BooleanToggle(False)  # disabled
number_slider_11 = Slider(0, range=0..10)  # disabled
mesh_2 = Mesh(mesh_uv)  # disabled
gradientlibrary = Ladybug_GradientLibrary(gradIndex=number_slider_11)  # -> customColors; disabled; plug-in component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
legendpar = Ladybug_LegendParameters(customColors=flatten(gradientlibrary))  # -> legendPar; disabled; plug-in component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
Y = UnitY(Factor=1)  # disabled
radiationanalysis = Ladybug_RadiationAnalysis(
    north=Y,
    geometry=flatten(mesh_uv),
    context=flatten(smesh),
    gridSize=number_slider_10,
    disFromBase=number_slider_9,
    selectedSkyMtx=flatten(selectskymtx.selectedSkyMtx),
    legendPar=flatten(legendpar),
    runIt=toggle_3)  # -> readMe, contextMesh, analysisMesh, testPts, testVec, port, radiationResult, radiationMesh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; disabled; plug-in component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

panel_2 = Panel(ladybug)  # disabled

number_slider_12 = Slider(0.5, range=0..1)  # disabled
number_slider_13 = Slider(3, range=0..10)  # disabled
number_slider_14 = Slider(1, range=0..100)  # disabled
avr = Average(Input=pcen.CenterV)  # disabled
sunpath = Ladybug_SunPath(
    location=importepw.location,
    hour=12,
    day=number_slider_14,
    month=number_slider_13,
    timeStep=1,
    centerPt=avr,
    sunPathScale=number_slider_12,
    dailyOrAnnualSunPath=True)  # -> readMe, sunVectors, sunAltitudes, sunAzimuths, port, sunSpheresMesh, sunPathCrvs, compassCrvs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; plug-in component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
ln_2 = Line(StartPoint=sunpath.sunPositions, EndPoint=avr)

# ----
# Step4.日照数値を利用してガラスパネルをパラメトリックにデザインする
日照数値 = Slider(0.55, range=0..1)
larger = LargerThan(FirstNumber=radiationanalysis.radiationResult, SecondNumber=日照数値)  # -> LargerThan, OrEqualTo
ma = MassAddition(Input=flatten(larger.LargerThan))  # -> Result, PartialResults
num = Number(ma.Result)

# ----
# Step3.ガラパゴスを使ってベースサーフェスを最適化
panel_3 = Panel("日照数値で入れた数字以下のものができるだけ少なくなるようにパラメータを探し出す")
ma_2 = MassAddition(Input=flatten(radiationanalysis.radiationResult))  # -> Result, PartialResults
num_2 = Number(ma_2.Result)

# ---- group: Step5 / Step5-1
galapagos = Galapagos(fitness=num, gene=[カーブ同士の角度, number_slider, number_slider_2])
panel_4 = Panel(num)

# ----
data_7 = Data(Tree({0}: [0.7658827993, 0.8084834996, 0.7913319949, 0.683552834, 0.6140225745, 0.4440109379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], {1}: [0.914416492, 0.9333087809, 0.9332592783, 0.8052781521, 0.683014707, 0.4888622178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], {2}: [1.074847531, 0.9970776557, 0.883560458, 0.7182418799, 0.6114618763, 0.3193761829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], {3}: [1.016806183, 0.9198157974, 0.7680994222, 0.4881937606, 0.3949948452, 0.1538990475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], {4}: [0.8727705553, 0.7131478969, 0.5669807654, 0.470526365, 0.2224829791, 0.1311371763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], {5}: [0.8100148747, 0.6703443729, 0.5383883326, 0.3389608988, 0.2206852381, 0.1490141273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], {6}: [1.206431209, 1.207345808, 1.180666453, 1.121828062, 0.9378013938, 0.8251368438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], {7}: [1.209100408, 1.201055348, 1.167296686, 1.101611777, 1.011395057, 0.8964566297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], {8}: [1.209718446, 1.192555311, 1.148517667, 1.076854238, 0.9810484014, 0.860685769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], {9}: [1.206879484, 1.182215827, 1.129456237, 1.048200176, 0.9469651856, 0.8241999152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], {10}: [1.200168885, 1.16762164, 1.108808953, 1.02445257, 0.920330045, 0.8052576595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]))
explode_2 = MeshExplode(Mesh=mesh_uv, Interpolate=False)  # -> simplify(Faces)
faceb_3 = FaceBoundaries(Mesh=explode_2)  # -> simplify(Boundaries)
pcen_2 = PolygonCenter(Polyline=faceb_3)  # -> CenterV, CenterE, CenterA
number_slider_15 = Slider(0.9, range=0..1)
pshift_3 = ShiftPaths(Data=faceb_3, Offset=-1)
pshift_4 = ShiftPaths(Data=pcen_2.CenterV, Offset=-1)

avr_2 = Average(Input=data_7)
bnd = Bounds(Numbers=flatten(avr_2))
dom = ConstructDomain(DomainStart=Slider(0.9, range=0..1), DomainEnd=Slider(0.5, range=0..1))
remap = RemapNumbers(Value=data_7, Source=bnd, Target=dom)  # -> Mapped, Clipped

scale_nu = ScaleNU(Geometry=pshift_3, Plane=pshift_4, ScaleX=number_slider_15, ScaleY=number_slider_15, ScaleZ=remap.Clipped)  # -> Geometry, Transform
merge_4 = Merge(Data1=simplify(graft(faceb_3)), Data2=simplify(graft(scale_nu.Geometry)))
boundary_2 = BoundarySurfaces(Edges=merge_4)

preview_3 = CustomPreview(Geometry=boundary_2, Material=ColourSwatch(SwatchColor=RGB(148, 159, 161)))

boundary_3 = BoundarySurfaces(Edges=scale_nu.Geometry)
preview_4 = CustomPreview(Geometry=boundary_3, Material=ColourSwatch(SwatchColor=RGBA(163, 206, 214, 86)))
